vi "Throughput processing.gvi"   [LabVIEW NXG 5.1.0]
inputs:
  "Input Throughput": f64
outputs:
  "Throuhgput History": f64[]
  "Average Throughput": f32
diagram:
  Feedback Node(input=w1) -> w2
  Build Array(w2, $"Input Throughput") -> w1
  $"Throuhgput History" <- w1
  Feedback Node(input=w3) -> w4
  Add(w4, $"Input Throughput") -> w3
  Array Size(array=w1) -> (size(s)=w5)
  To Double Precision Float(number=w5) -> w6
  Divide(x=w3, y=w6) -> w7
  $"Average Throughput" <- w7
