vi "RX command.gvi"   [LabVIEW NXG 5.1.0]
inputs:
  "RX_command": f32[]
outputs:
  "RX_Frequency [Hz]": f32
  "RX_Sample_Rate [S/s]": f32
  "Equalizer": string
  "N iterations": f32
diagram:
  Array Index(array=$RX_command) -> (out0[0]=w1)
  $"RX_Frequency [Hz]" <- w1
  Array Index(array=$RX_command) -> (out0[1]=w2)
  $"RX_Sample_Rate [S/s]" <- w2
  Array Index(array=$RX_command) -> (out0[2]=w3)
  $"N iterations" <- w3
  Array Index(array=$RX_command) -> (out0[3]=w4)
  To Unsigned 8 Bit Integer(number=w4) -> w5
  case (w5) {
    frame 0, Default {
      w6 = "CWCU_MMSE_low_complexity"
    }
    frame 1 {
      w6 = "CWCU_MMSE_general"
    }
    frame 2 {
      w6 = "wrong input"
    }
    frame 3 {
      w6 = "wrong input"
    }
  }
  $Equalizer <- w6
