vi "TX commands.gvi"   [LabVIEW NXG 5.1.0]
inputs:
  "TX_command": f32[]
outputs:
  "TX.Frequency [Hz]": f32
  "TX.Sample Rate[S/s]": f32
  "J (QAM order)": f32
  "R": f32
  "encoder": string
  "K": f32
  "M": f32
  "P [W]": f32
  "Wave.name": string
  "Waveform.Q": f32
  "Waveform.Q2": f32
  "puncture code": string
panel indicators:
  "punc code size": f32
diagram:
  Array Index(array=$TX_command) -> (out0[0]=w1)
  $"TX.Frequency [Hz]" <- w1
  Array Index(array=$TX_command) -> (out0[1]=w2)
  $"TX.Sample Rate[S/s]" <- w2
  Array Index(array=$TX_command) -> (out0[2]=w3)
  $"J (QAM order)" <- w3
  Array Index(array=$TX_command) -> (out0[3]=w4)
  $R <- w4
  Array Index(array=$TX_command) -> (out0[4]=w5)
  To Unsigned 8 Bit Integer(number=w5) -> w6
  case (w6) {
    frame 0, Default {
      w7 = "PC_convolutional"
    }
    frame 1 {
      w7 = "convolutional"
    }
    frame 2 {
      w7 = "wrong input"
    }
  }
  $encoder <- w7
  Array Index(array=$TX_command) -> (out0[5]=w8)
  $K <- w8
  Array Index(array=$TX_command) -> (out0[6]=w9)
  $M <- w9
  Array Index(array=$TX_command) -> (out0[7]=w10)
  $"P [W]" <- w10
  Array Index(array=$TX_command) -> (out0[8]=w11)
  To Unsigned 8 Bit Integer(number=w11) -> w12
  case (w12) {
    frame 0, Default {
      w13 = "SWH"
    }
    frame 1 {
      w13 = "OTFS"
    }
    frame 2 {
      w13 = "OCDM"
    }
    frame 3 {
      w13 = "wrong input"
    }
  }
  $"Wave.name" <- w13
  Array Index(array=$TX_command) -> (out0[9]=w14)
  $"Waveform.Q" <- w14
  Array Index(array=$TX_command) -> (out0[10]=w15)
  $"Waveform.Q2" <- w15
  Array Index(array=$TX_command) -> (out0[11]=w16)
  $"punc code size" <- w16
  To Signed 32 Bit Integer(number=w16) -> w17
  Array Subset(array=$TX_command, index0=12, length0=w17) -> w18
  Array To Spreadsheet String(array=w18, delimiter=" ", format string="%d") -> (spreadsheet string=w19)
  $"puncture code" <- w19
