vi "show data type.gvi"   [LabVIEW NXG 5.1.0]
inputs:
  "array": f32[]
outputs:
  "output array": f32[]
  "data type": string
diagram:
  Delete From Array(inArray=$array, index0=0) -> (outArray=w1, deleted=w2)
  $"output array" <- w1
  To Unsigned 8 Bit Integer(number=w2) -> w3
  case (w3) {
    frame 0, Default {
      w4 = "array or matrix"
    }
    frame 1 {
      w4 = "random bits"
    }
    frame 2 {
      w4 = "wrong input"
    }
  }
  $"data type" <- w4
