vi "UDP_Interface.gvi"   [LabVIEW NXG 5.1.0]
panel controls:
  "Net Address": string = "127.0.0.1"
  "Read Port 8847": u16 = 8847
  "Write Port 8848": u16 = 8848
panel indicators:
  "Tab": i32
  "TX.Frequency [Hz]": f32
  "TX.Sample Rate[S/s]": f32
  "J (QAM order)": f32
  "R": f32
  "encoder": string
  "K": f32
  "M": f32
  "Transmit power [W]": f32
  "Waveform.name": string
  "Waveform.Q": f32
  "Waveform.Q2": f32
  "puncture code": string
  "RX_Frequency [Hz]": f32
  "RX_Sample_Rate [S/s]": f32
  "TX parameters size": f32
  "total number of TX command packets": f32
  "N iterations": f32
  "Equalizer": string
  "total number of RX command packets": f32
  "RX parameters size": f32
  "Total number of data packets": f32
  "Data payload size": f32
  "Data type": string
  "Data packets counter": f32
  "One transmission over ?": bool
  "Throughput (MB/s)": f64
  "Throughput Graph": f64[]
  "Average Throughput(MB/s)": f32
  "Retransmission": bool
  "Received Information": f32[]
  "Data out": f32[]
  "Status out": f32[]
uses:
  Host::UDP_commuication::UDP read functions::byte2single.gvi
  Host::UDP_commuication::UDP read functions::TX commands.gvi
  Host::UDP_commuication::UDP read functions::RX command.gvi
  Host::UDP_commuication::UDP read functions::show data type.gvi
  NI::G Core::Error::Filter Error Code.gvi
  Host::UDP_commuication::Throughput processing.gvi
  NI::G Core::Error::Display Error.gvi
diagram:
  Reinitialize To Default(reference in=reference to "Waveform.Q") -> (reference out=w1, error out=w2)
  Close Reference(error in=w2, reference=w1)
  Reinitialize To Default(reference in=reference to "TX.Sample Rate[S/s]") -> (reference out=w3, error out=w4)
  Close Reference(error in=w4, reference=w3)
  Reinitialize To Default(reference in=reference to "TX.Frequency [Hz]") -> (reference out=w5, error out=w6)
  Close Reference(error in=w6, reference=w5)
  $Tab <- 0
  Reinitialize To Default(reference in=reference to "Transmit power [W]") -> (reference out=w7, error out=w8)
  Close Reference(error in=w8, reference=w7)
  w9 = $"Write Port 8848"
  w10 = $"Net Address"
  w11 = $"Read Port 8847"
  while {
    Udp Open(net address=w10, port=w11) -> (connection ID=w12, error out=w13)
    FPGA Open Node(RIO address="RIO0", error in=w13, run?=TRUE) -> (error out=w14, reference out=w15)
    FPGA Run Node(error in=w14, reference in=w15) -> (error out=w16, reference out=w17)
    Host Fifo Configure Node[FifoName="Toplevel_FPGA::Resources.grsc::H2T"](depth=10000, error in=w16, reference in=w17) -> (error out=w18, reference out=w19)
    Host Fifo Start Node[FifoName="Toplevel_FPGA::Resources.grsc::H2T"](error in=w18, reference in=w19) -> (error out=w20, reference out=w21)
    Host Fifo Configure Node[FifoName="Toplevel_FPGA::Resources.grsc::T2H"](depth=10000, error in=w16, reference in=w17) -> (error out=w22, reference out=w23)
    Host Fifo Start Node[FifoName="Toplevel_FPGA::Resources.grsc::T2H"](error in=w22, reference in=w23) -> (error out=w24)
    Merge Errors(w20, w24) -> (error out=w25)
    case (w25) {
      frame Error, Default {
        w26 = w25
        w27 = w21
        w28 = w25
        w29 = w12
      }
      frame No Error {
        while {
          # maximum wait 20s
          Udp Read Binary(connection ID=w12, error in=w25, max size=5480, timeout ms=45000) -> (connection ID out=w29, data out=w30, error out=w31)
          # remove ID and get ID
          call "byte2single.gvi"(array=w30) -> (Output=w32)
          Delete From Array(inArray=w32, index0=0) -> (outArray=w33, deleted=w34)
          To Unsigned 16 Bit Integer(number=w34) -> w35
          case (w35) {
            frame 0, Default {
              # get total number of TX command packets and remove it
              Delete From Array(inArray=w33, index0=0) -> (outArray=w37, deleted=w38)
              Delete From Array(inArray=w37, index0=0) -> (outArray=w39, deleted=w40)
              # get TX command and
              # sim_parameters
              # payload size and remove it
              call "TX commands.gvi"(TX_command=w39) -> (TX.Frequency [Hz]=w41, TX.Sample Rate[S/s]=w42, J (QAM order)=w43, R=w44, encoder=w45, K=w46, M=w47, P [W]=w48, Wave.name=w49, Waveform.Q=w50, Waveform.Q2=w51, puncture code=w52)
              $"TX.Frequency [Hz]" <- w41
              $"TX.Sample Rate[S/s]" <- w42
              $"J (QAM order)" <- w43
              $R <- w44
              $encoder <- w45
              $K <- w46
              $M <- w47
              $"Transmit power [W]" <- w48
              $"Waveform.name" <- w49
              $"Waveform.Q" <- w50
              $"Waveform.Q2" <- w51
              $"puncture code" <- w52
              $"TX parameters size" <- w40
              $"total number of TX command packets" <- w38
              Property Node(instance in=w21, "reset in"=FALSE) -> (instance out=w27)
              w36 = w25
            }
            frame 1 {
              # get total number of RX command packets and remove it
              Delete From Array(inArray=w33, index0=0) -> (outArray=w53, deleted=w54)
              # get total number of RX command packets and remove it
              Delete From Array(inArray=w53, index0=0) -> (outArray=w55, deleted=w56)
              call "RX command.gvi"(RX_command=w55) -> (RX_Frequency [Hz]=w57, RX_Sample_Rate [S/s]=w58, N iterations=w59, Equalizer=w60)
              $"RX_Frequency [Hz]" <- w57
              $"RX_Sample_Rate [S/s]" <- w58
              $"N iterations" <- w59
              $Equalizer <- w60
              $"RX parameters size" <- w56
              $"total number of RX command packets" <- w54
              Property Node(instance in=w21, "reset in"=FALSE) -> (instance out=w27)
              w36 = w25
            }
            frame 2 {
              Delete From Array(inArray=w33, index0=0) -> (outArray=w61, deleted=w62)
              Delete From Array(inArray=w61, index0=0) -> (outArray=w63, deleted=w64)
              call "show data type.gvi"(array=w63) -> (output array=w65, data type=w66)
              $"Data type" <- w66
              $"Data payload size" <- w64
              $"Total number of data packets" <- w62
              To Unsigned 32 Bit Integer(number=w64) -> w67
              Property Node(instance in=w21, "UDP data packet size_in"=w67, "reset in"=FALSE)
              Array Size(array=w65) -> (size(s)=w68)
              To Single Precision Float(number=w68) -> w69
              Is Not Equal To 0(x=w68) -> w70
              case (w70) {
                frame False, Default {
                  w71 = w65
                }
                frame True {
                  Feedback Node(initial value=0, input=w72) -> w73
                  Increment(x=w73) -> w74
                  $"Data packets counter" <- w74
                  Is Equal(x=w74, y=w62) -> w75
                  case (w75) {
                    frame False, Default {
                      w72 = w74
                      w76 = FALSE
                    }
                    frame True {
                      w72 = 0
                      w76 = TRUE
                    }
                  }
                  $"One transmission over ?" <- w76
                  w71 = w65
                }
              }
              Reinterpret Number[RestrictToSameWordLength=True](data in=w71, type=u32 0) -> (data out=w77)
              Host Fifo Write Node[FifoName="Toplevel_FPGA::Resources.grsc::H2T"](data=w77, error in=w25, reference in=w21) -> (error out=w36, reference out=w27)
            }
            frame 3 {
              Delete From Array(inArray=w33, index0=0) -> (deleted=w78)
              Is Not Equal To 0(x=w78) -> w79
              $Retransmission <- w79
              w36 = w25
              w27 = w21
            }
          }
          call "Filter Error Code.gvi"(error in=w31, code to clear=56) -> (error out=w26)
          $"Received Information" <- w33
          Wait(time to wait=400)
          Property Node(instance in=reference to "Retransmission") -> ("Value"=w80)
          Logical Or(w80, FALSE) -> w81
          stop if w81
        }
        while {
          Host Fifo Read Node[FifoName="Toplevel_FPGA::Resources.grsc::T2H"](error in=w25, number of elements=0, reference in=w21, timeout (ms)=45000) -> (elements remaining=w82, error out=w83, reference out=w84)
          Host Fifo Read Node[FifoName="Toplevel_FPGA::Resources.grsc::T2H"](error in=w83, number of elements=w82, reference in=w84, timeout (ms)=45000) -> (data=w85, error out=w86)
          Reinterpret Number[RestrictToSameWordLength=True](data in=w85, type=f32 0) -> (data out=w87)
          Type Cast(type=u8[] [], x=w87) -> w88
          Udp Write Binary(address=w10, connection ID=w12, data in=w88, error in=w86, port or service name=w9, timeout ms=45000) -> (error out=w89)
          $"Data out" <- w87
          Property Node(instance in=reference to "Retransmission") -> ("Value"=w90)
          Logical Or(w90, FALSE) -> w91
          Wait(time to wait=400)
          stop if w91
        }
        Merge Errors(w36, w89) -> (error out=w28)
        while {
          Property Node(instance in=w21, error in=w25) -> ("number of elements read"=w92, "iteration"=w93, "UDP data packet size_2_out"=w94)
          Feedback Node(input=w92) -> w95
          Subtract(x=w92, y=w95) -> w96
          Feedback Node(input=w93) -> w97
          Subtract(x=w93, y=w97) -> w98
          Is Not Equal To 0(x=w98) -> w99
          case (w99) {
            frame False, Default {
              w100 = 0
            }
            frame True {
              w101 = 80  # transfer rate (MHz)
              To Double Precision Float(number=w96) -> w102
              To Double Precision Float(number=w98) -> w103
              Divide(x=w102, y=w103) -> w104
              w105 = 4  # Bytes per transfer
              To Double Precision Float(number=w105) -> w106
              Multiply(w104, w106) -> w107
              Multiply(w107, w101) -> w100
            }
          }
          $"Throughput (MB/s)" <- w100
          call "Throughput processing.gvi"(Input Throughput=w100) -> (Throuhgput History=w108, Average Throughput=w109)
          $"Throughput Graph" <- w108
          $"Average Throughput(MB/s)" <- w109
          To Single Precision Float(number=w94) -> w110
          Build Array(6, w110, w109) -> w111
          Type Cast(type=u8[] [], x=w111) -> w112
          Udp Write Binary(address=w10, connection ID=w12, data in=w112, port or service name=w9, timeout ms=45000)
          $"Status out" <- w111
          Wait(time to wait=500)
          # 6 is status ID, this will tell Matlab this packet is status
          Property Node(instance in=reference to "Retransmission") -> ("Value"=w113)
          Logical Or(w113, FALSE) -> w114
          stop if w114
        }
      }
    }
    Udp Close(connection ID=w29, error in=w26) -> (error out=w115)
    call "Display Error.gvi"(error in=w115)
    Host Fifo Stop Node[FifoName="Toplevel_FPGA::Resources.grsc::H2T"](error in=w28, reference in=w27) -> (error out=w116, reference out=w117)
    Host Fifo Stop Node[FifoName="Toplevel_FPGA::Resources.grsc::T2H"](error in=w116, reference in=w117) -> (error out=w118, reference out=w119)
    FPGA Close Node[HasAbortTerminal=False](error in=w118, reference in=w119) -> (error out=w120)
    call "Display Error.gvi"(error in=w120)
    stop if FALSE
  }
  Reinitialize To Default(reference in=reference to "R") -> (reference out=w121, error out=w122)
  Close Reference(error in=w122, reference=w121)
  Reinitialize To Default(reference in=reference to "puncture code") -> (reference out=w123, error out=w124)
  Close Reference(error in=w124, reference=w123)
  Reinitialize To Default(reference in=reference to "K") -> (reference out=w125, error out=w126)
  Close Reference(error in=w126, reference=w125)
  Reinitialize To Default(reference in=reference to "J (QAM order)") -> (reference out=w127, error out=w128)
  Close Reference(error in=w128, reference=w127)
  Reinitialize To Default(reference in=reference to "encoder") -> (reference out=w129, error out=w130)
  Close Reference(error in=w130, reference=w129)
  Reinitialize To Default(reference in=reference to "M") -> (reference out=w131, error out=w132)
  Close Reference(error in=w132, reference=w131)
  Reinitialize To Default(reference in=reference to "Waveform.name") -> (reference out=w133, error out=w134)
  Close Reference(error in=w134, reference=w133)
  Reinitialize To Default(reference in=reference to "Waveform.Q2") -> (reference out=w135, error out=w136)
  Close Reference(error in=w136, reference=w135)
