vi "show in matrix.gvi"   [LabVIEW NXG 5.1.0]
inputs:
  "array": c64[]
  "row": u32
  "column": u32
outputs:
  "matrix": c64[][]
diagram:
  To Signed 32 Bit Integer(number=$column) -> w1
  To Signed 32 Bit Integer(number=$row) -> w2
  Reshape Array(inArray=$array, size=w1, size=w2) -> w3
  Transpose 2D Array(2D array=w3) -> (transposed array=w4)
  $matrix <- w4
