vi "FPGA_Top.gvi"   [LabVIEW NXG 5.1.0]
panel controls:
  "number of data packets_in": u32
  "UDP data packet size_in": u32
  "last_data_packet_size_in": u32
  "reset in": bool
panel indicators:
  "number of data packets_out": u32
  "UDP data packet size_2_out": u32
  "last_data_packet_size_out": u32
  "valid sample": bool
  "number of elements read": i32
  "iteration": u64
  "reset out": bool
diagram:
  clock-driven loop (clock = "Toplevel_FPGA::Resources.grsc::DerivedClock") forever {
    FIFO Read(Control Protocol Input=TRUE, reference in="Toplevel_FPGA::Resources.grsc::H2T") -> (Control Protocol Output=w1, data=w2)
    FIFO Write(Control Protocol Input=w1, data=w2, reference in="Toplevel_FPGA::Resources.grsc::T2H")
    $"valid sample" <- w1
    Select(s=w1, t=1, f=0) -> w3
    # number of elements read
    Feedback Node(input=w4) -> w5
    Add(w5, w3) -> w4
    $"number of elements read" <- w4
    $"reset out" <- $"reset in"
    Feedback Node(input=w6) -> w7
    $iteration <- w7
    # iteration
    Increment(x=w7) -> w6: u64
    $"number of data packets_out" <- $"number of data packets_in"
    $"UDP data packet size_2_out" <- $"UDP data packet size_in"
    $last_data_packet_size_out <- $last_data_packet_size_in
  }
