vi "byte2single.gvi"   [LabVIEW NXG 5.1.0]
inputs:
  "array": u8[]
outputs:
  "Output": f32[]
diagram:
  Initialize Array(element=0, size=0) -> w1
  Array Size(array=$array) -> (size(s)=w2)
  To Single Precision Float(number=w2) -> w3
  To Single Precision Float(number=4) -> w4
  Divide(x=w3, y=w4) -> w5: f32
  To Signed 32 Bit Integer(number=w5) -> w6
  for (N = w6) (iteration -> i1) {
    Multiply(4, i1) -> w8
    Array Subset(array=$array, index0=w8, length0=4) -> w9
    Type Cast(type=f32 0, x=w9) -> w10
    append w10 to w7
  }
  s1 = w7  # shift register
  while (iteration -> i2) {
    Insert Into Array(inArray=w1, new=s1) -> w11
    Is Greater(x=w6, y=i2) -> w12
    next s1 = w11
    stop if w12
  }
  $Output <- s1
