vi "UDP_Interface.gvi"   [LabVIEW NXG 5.1.0]
inputs:
  "net address": string = "127.0.0.1"
  "port_recevie 8847": u16 = 8847
panel controls:
  "port_send 8848": u16 = 8847
panel indicators:
  "matrix": c128[][]
uses:
  Lib_Host::UDP_communication::UDP receive::check header and tail.gvi
  Lib_Host::UDP_communication::UDP send::prepare frame.gvi
  Lib_Host::UDP_communication::UDP send::send operation.gvi
  Lib_Host::UDP_communication::other::convert into matrix.gvi
  NI::G Core::Error::Display Error.gvi
diagram:
  w1 = $"port_send 8848"
  while {
    Udp Open(net address=$"net address", port=$"port_recevie 8847") -> (connection ID=w2, error out=w3)
    s1 = uninitialised  # shift register
    while (iteration -> i1) {
      Udp Read Binary(connection ID=w2, error in=w3, timeout ms=100) -> (connection ID out=w4, data out=w5, error out=w6)
      call "check header and tail.gvi"(new array=w5, initialization=i1, existing array=s1) -> (Output=w7, row=w8, column=w9, flag=w10, output array=w11)
      call "prepare frame.gvi"(complex array=w7, row=w8, column=w9) -> (size=w12, array=w13)
      call "send operation.gvi"(error in=w6, connection ID in=w4, arrary size=w12, array=w13, selector=w10, address=$"net address", port or service name=w1) -> (connection ID out=w14, complete flag=w15, error out=w16)
      call "convert into matrix.gvi"(array=w7, row=w8, column=w9) -> (matrix=w17)
      next s1 = w11
      stop if w15
    }
    Udp Close(connection ID=w14, error in=w16) -> (error out=w18)
    call "Display Error.gvi"(error in=w18)
    $matrix <- w17
    stop if FALSE
  }
